# Grasshopper definition Kandinsky.gh (Grasshopper 0.9.80)

card_thickness = Slider(4.94, range=1..20)
size_mm_radius_5x_base_width = Slider(120, range=100..200)
r_to_d_2x = Number(2)
multiplication = Multiplication(A=size_mm_radius_5x_base_width, B=r_to_d_2x)
l1_60_3 = Number(0.603)
l1_81_8 = Number(0.818)
l1_69_8 = Number(0.698)
multiplication_2 = Multiplication(A=multiplication, B=l1_60_3)
multiplication_3 = Multiplication(A=multiplication, B=l1_81_8)
multiplication_4 = Multiplication(A=multiplication, B=l1_69_8)
circle = Circle(Plane=PlaneXY(0, 0, 0), Radius=size_mm_radius_5x_base_width)
to_negative_1 = Number(-1)
to_negative_1_2 = Number(-1)
to_negative_1_3 = Number(-1)
to_negative_1_4 = Number(-1)
multiplication_5 = Multiplication(A=Slider(113.994, range=0..500), B=to_negative_1)
multiplication_6 = Multiplication(A=Slider(92.132, range=0..500), B=to_negative_1_2)
multiplication_7 = Multiplication(A=Slider(33.669, range=0..500), B=to_negative_1_3)
multiplication_8 = Multiplication(A=Slider(13.491, range=0..500), B=to_negative_1_4)
rectangle = Rectangle(Plane=PlaneXY(0, 0, 0), XSize=multiplication_2, YSize=card_thickness, Radius=0)  # -> Rectangle, Length
rectangle_2 = Rectangle(Plane=PlaneXY(0, 0, 0), XSize=multiplication_3, YSize=card_thickness, Radius=0)  # -> Rectangle, Length
rectangle_3 = Rectangle(Plane=PlaneXY(0, 0, 0), XSize=multiplication_4, YSize=card_thickness, Radius=0)  # -> Rectangle, Length
vector_xyz = VectorXYZ(XComponent=multiplication_5, YComponent=Slider(28.491, range=0..500), ZComponent=0)  # -> Vector, Length
vector_xyz_2 = VectorXYZ(XComponent=multiplication_6, YComponent=Slider(0, range=0..500), ZComponent=0)  # -> Vector, Length
vector_xyz_3 = VectorXYZ(XComponent=multiplication_7, YComponent=multiplication_8, ZComponent=0)  # -> Vector, Length
radians = Radians(Degrees=Slider(52.48, range=0..360))
radians_2 = Radians(Degrees=Slider(59.09, range=0..360))
move = Move(Geometry=rectangle.Rectangle, Motion=vector_xyz.Vector)  # -> Geometry, Transform
move_2 = Move(Geometry=rectangle_2.Rectangle, Motion=vector_xyz_2.Vector)  # -> Geometry, Transform
radians_3 = Radians(Degrees=Slider(80.85, range=0..360))
move_3 = Move(Geometry=rectangle_3.Rectangle, Motion=vector_xyz_3.Vector)  # -> Geometry, Transform
area = Area(Geometry=move.Geometry)  # -> Area, Centroid
area_2 = Area(Geometry=move_2.Geometry)  # -> Area, Centroid
area_3 = Area(Geometry=move_3.Geometry)  # -> Area, Centroid
rotate = Rotate(Geometry=move.Geometry, Angle=radians, Plane=area.Centroid)  # -> Geometry, Transform
rotate_2 = Rotate(Geometry=move_2.Geometry, Angle=radians_2, Plane=area_2.Centroid)  # -> Geometry, Transform
rotate_3 = Rotate(Geometry=move_3.Geometry, Angle=radians_3, Plane=area_3.Centroid)  # -> Geometry, Transform
region_difference = RegionDifference(CurvesA=circle, CurvesB=rotate.Geometry)
region_difference_2 = RegionDifference(CurvesA=region_difference, CurvesB=rotate_2.Geometry)
region_difference_3 = RegionDifference(CurvesA=region_difference_2, CurvesB=rotate_3.Geometry)
number_slider = Slider(150, range=0..500)
d_to_r_5 = Number(0.5)
d_to_r_5_2 = Number(0.5)
d_to_r_5_3 = Number(0.5)
multiplication_9 = Multiplication(A=multiplication_4, B=d_to_r_5)
multiplication_10 = Multiplication(A=multiplication_2, B=d_to_r_5_2)
multiplication_11 = Multiplication(A=multiplication_3, B=d_to_r_5_3)
circle_2 = Circle(Plane=PlaneXY(0, 0, 0), Radius=multiplication_9)
circle_3 = Circle(Plane=PlaneXY(0, 0, 0), Radius=multiplication_10)
circle_4 = Circle(Plane=PlaneXY(0, 0, 0), Radius=multiplication_11)
vector_xyz_4 = VectorXYZ(XComponent=Slider(255, range=0..500), YComponent=0, ZComponent=0)  # -> Vector, Length
vector_xyz_5 = VectorXYZ(XComponent=0, YComponent=Slider(230, range=0..500), ZComponent=0)  # -> Vector, Length
vector_xyz_6 = VectorXYZ(XComponent=number_slider, YComponent=number_slider, ZComponent=0)  # -> Vector, Length
move_4 = Move(Geometry=circle_2, Motion=vector_xyz_5.Vector)  # -> Geometry, Transform
move_5 = Move(Geometry=circle_4, Motion=vector_xyz_4.Vector)  # -> Geometry, Transform
move_6 = Move(Geometry=circle_3, Motion=vector_xyz_6.Vector)  # -> Geometry, Transform
